# Grasshopper definition 221213_Substructure.ghx (Grasshopper 1.0.7)

# ---- group: No. Clusters
number_of_clusters = Panel("4")

# ---- group: num. agents in each cluster
genes = GenePool(Decimals=0, Maximum=20, Minimum=0, Value=[4, 8, 7, 8])

# ----
genes_2 = GenePool(Decimals=2, Maximum=1, Minimum=0, Value=[0.24, 0.49, 0.7, 0.82])
dom = ConstructDomain(DomainStart=Slider(0.1, range=0..0.1), DomainEnd=Slider(0.3, range=0..1))
random = Random(Range=dom, Number=Slider(4, range=0..10), Seed=Slider(5, range=0..10))
range = Range(Domain=Domain(0, 1), Steps=genes)
bang = ExplodeTree(Data=range)  # -> Branch0, Branch1, Branch2, Branch3
ghpython_script = GhPythonScript(centers=genes_2, extend=random)  # -> out, intervals; inputs centers: list, extend: list
# ---------- ghpython_script: Python ----------
import math
import ghpythonlib.treehelpers as th


intervals=[]

for center, ext in zip(centers, extend):
    inter_from = center- ext
    inter_to = center + ext
    print type(inter_from)
    if inter_from < 0 : 
        inter_from =0
    if inter_to >1 :
        inter_to =1
    
    intervals.append([inter_from, inter_to])

intervals = th.list_to_tree(intervals)
# ---------- end ghpython_script ----------
graph = GraphMapper(bang.Branch0, x0=0, x1=1, y0=0, y1=1, container_name="Bezier", cpx=[0, 0.5243950486, 0.4586946666, 1], cpy=[0, 0, 1, 1])
graph_2 = GraphMapper(
    bang.Branch2,
    x0=0,
    x1=1,
    y0=0,
    y1=1,
    container_name="Sinc",
    Equation_X0=0.4748720825,
    Equation_X1=0.8085743189,
    Equation_Y0=0.9733063579,
    Equation_Y1=0.05741548538)
graph_3 = GraphMapper(bang.Branch3, x0=0, x1=1, y0=0, y1=1, Cx=0.4874807298, Cy=0.7769420147, container_name="Conic")

# ---- group: Target factor
graph_4 = GraphMapper(bang.Branch0, x0=0, x1=1, y0=0, y1=1, container_name="Bezier", cpx=[0, 0.5243950486, 0.4586946666, 1], cpy=[0, 0, 1, 1])
graph_5 = GraphMapper(
    bang.Branch2,
    x0=0,
    x1=1,
    y0=0,
    y1=1,
    container_name="Sinc",
    Equation_X0=0.4748720825,
    Equation_X1=0.8085743189,
    Equation_Y0=0.9733063579,
    Equation_Y1=0.05741548538)
graph_6 = GraphMapper(bang.Branch3, x0=0, x1=1, y0=0, y1=1, Cx=0.4874807298, Cy=0.7769420147, container_name="Conic")
graph_7 = GraphMapper(bang.Branch1, x0=0, x1=1, y0=0, y1=1, Ox=0.4780313373, Oy=1, Px=1, Py=0.1196134686, container_name="Parabola")
merge = Merge(Data1=graph_4, Data2=graph_7, Data3=graph_5, Data4=graph_6)
bnd = Bounds(Numbers=merge)
remap = RemapNumbers(Value=merge, Source=bnd, Target=Domain(0, 1))  # -> Mapped, Clipped

# ----
graph_8 = GraphMapper(bang.Branch1, x0=0, x1=1, y0=0, y1=1, Ox=0.4780313373, Oy=1, Px=1, Py=0.1196134686, container_name="Parabola")
merge_2 = Merge(Data1=graph, Data2=graph_8, Data3=graph_2, Data4=graph_3)
sort = SortList(Keys=merge_2)  # -> Keys, ValuesA
bnd_2 = Bounds(Numbers=merge_2)
remap_2 = RemapNumbers(Value=sort.Keys, Source=bnd_2, Target=ghpython_script.intervals)  # -> Mapped, Clipped
panel = Panel("C:\Users\eleni\Documents\GitHub\3d_printing_teamwork\Design_Substructure\221213_Substructure_khara_working.py")
number_slider = Slider(56, range=0..1000)
read_file = ReadFile(File=panel, PerLineParse=False)

geometry = Geometry(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)
geometry_2 = Geometry(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)
geometry_3 = Geometry(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)
geometry_4 = Geometry(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)

surface = Surface(reparameterize(geometry))
ghpython_script_2 = GhPythonScript(
    Code=read_file,
    Time_1=Slider(100, range=0..100),
    Time_2=Slider(0, range=0..100),
    Surface=surface,
    U_div=number_slider,
    V_div=number_slider,
    U_lists=remap_2.Mapped,
    Target_factors=remap.Clipped,
    Coherence_rad=Slider(33, range=0..100),
    Coherence_fac=Slider(0.6, range=0..1),
    Coherence_T=Toggle(True),
    Align_rad=Slider(13, range=0..100),
    Align_fac=Slider(0.5, range=0..1),
    Alignment_T=Toggle(True),
    Avoid_rad=Slider(41, range=0..100),
    Avoid_fac=Slider(1.1, range=0..50),
    Separation_T=Toggle(True))  # -> Out, List_pts, Paths
ghpython_script_3 = GhPythonScript(x=surface)  # -> out, a; inputs x: Surface
# ---------- ghpython_script_3: Python ----------
import Rhino.Geometry as rg

a = x.PointAt(1,0)
# ---------- end ghpython_script_3 ----------
panel_2 = Panel([surface, number_slider])
curve = Curve(ghpython_script_2.Paths)
geometry_5 = Geometry(ghpython_script_2.List_pts)
panel_3 = Panel(ghpython_script_2.Out)
panel_4 = Panel(geometry_5)
