# Grasshopper definition fabrication_and_visualization.ghx (Grasshopper 1.0.7)

# WORKING FILES
panel = Panel("/working_file_zac/excution.py")
ghpython_script = GhPythonScript(file_name=panel)  # -> path
# ---------- ghpython_script: Python ----------
a = ghdoc.Path

path = a.split('3d_printing_teamwork')[0]+r'3d_printing_teamwork\\'+file_name
# ---------- end ghpython_script ----------
ghpython_script_2 = GhPythonScript(file_name="\fabrication\master_navigation_data.json")  # -> path; same code as ghpython_script
read_file = ReadFile(File=ghpython_script, PerLineParse=False)

debug_robot_acc = Slider(0.5, range=0..1)
debug_robot_vel = Slider(0.5, range=0..1)
send_debug_plane = Button()

X = Slider(100, range=-100..100)
Z = Slider(100, range=-100..100)
Y = Slider(100, range=-100..100)
construct_point = ConstructPoint(XCoordinate=X, YCoordinate=Y, ZCoordinate=Z)

python = GhPythonScript(
    Code=read_file,
    NAVIGATION_JSON=ghpython_script_2,
    DEBUG_ROBOT_ACC=debug_robot_acc,
    DEBUG_ROBOT_VEL=debug_robot_vel,
    Send_debug_plane=send_debug_plane,
    Debug_plane=construct_point)  # -> Out, Script
panel_2 = Panel(python.Out)
panel_3 = Panel(python.Script)
