# Grasshopper definition combine.gh (Grasshopper 1.0.7)

panel = Panel("C:\Users\Zac\Desktop")
read_file = ReadFile(PerLineParse=False)

# ---- group: single_curve
curve = Curve(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)

# ----
surface = Surface(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)
surface_2 = Surface(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)
point = Point(Point(-556.4288437, 6.329469364, 0))

ghpython_script = GhPythonScript()  # -> Out, OutTemp
_0_to_1_00 = Slider(0, range=0..1)
_1_to_100 = Slider(0, range=0..100)
c_script = CSharpScript()  # -> Out, A
number_slider = Slider(0.01, range=0..0.01)
number_slider_2 = Slider(0.5, range=0..1)

# ---- group: INPUT CRV, SRF, PT
curve_2 = Curve(<curve referenced from the Rhino model>)
surface_3 = Surface(<surface referenced from the Rhino model>)
point_2 = Point(Point(-378.6698619, -355.1761771, 77.90668962))

# ----
curve_to_polyline = CurveToPolyline(Curve=curve_2, ToleranceDistance=0, ToleranceAngle=number_slider_2)  # -> Polyline, Segments

planes_spacing = Slider(10, range=0..20)
length = Length(Curve=curve_2)
division = Division(A=length, B=planes_spacing)
integer = Integer(division)

simplify_curve = SimplifyCurve(Curve=curve_2, AngleTolerance=number_slider_2)  # -> Curve, Simplified
control_points = ControlPoints(Curve=curve_to_polyline.Polyline)  # -> Points, Weights, Knots

# ---- group: Layer variation plane adjustment
min_layer_height = Slider(0.5, range=0..10)
max_layer_height = Slider(1.5, range=0..10)

# ---- group: PRINT ADJUSTMENT LAYER VALUES
layer_nbr = Slider(20, range=0..100)
layer_height = Slider(0.25, range=0..5)

# ---- group: ALL PLANES
geometry = Geometry([Point(20.11241087, -268.0994345, 166.8389438), Point(14.91492845, -266.6103508, 160.828328), Point(21.50814431, -265.3542559, 161.5611426), Point(21.37283391, -265.900737, 162.7330684), Point(18.20059355, -264.8780917, 158.4823961), Point(24.26334024, -262.2164061, 155.575904)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])
geometry_2 = Geometry([Point(20.11241087, -268.0994345, 166.8389438), Point(14.91492845, -266.6103508, 160.828328), Point(21.50814431, -265.3542559, 161.5611426), Point(21.37283391, -265.900737, 162.7330684), Point(18.20059355, -264.8780917, 158.4823961), Point(24.26334024, -262.2164061, 155.575904)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])
geometry_3 = Geometry([Point(20.11241087, -268.0994345, 166.8389438), Point(14.91492845, -266.6103508, 160.828328), Point(21.50814431, -265.3542559, 161.5611426), Point(21.37283391, -265.900737, 162.7330684), Point(18.20059355, -264.8780917, 158.4823961), Point(24.26334024, -262.2164061, 155.575904)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])

# ---- group: 10 PLANES
geometry_4 = Geometry([Plane(origin=(20.00949203, -267.6585518, 167.051147), x=(-0.9765919175, -0.212767767, -0.03159278532), y=(0.06244257573, -0.4209748274, 0.9049205045)), Plane(origin=(18.54185183, -253.8058761, 119.1938906), x=(-0.9698341398, -0.2434366882, -0.01266175937), y=(0.01972924504, -0.1301597398, 0.991296726)), Plane(origin=(2.716405825, -255.3842468, 81.32405356), x=(-0.9814958783, -0.1914477887, 0.003685800351), y=(-0.002470917068, 0.03191004211, 0.9994876907)), Plane(origin=(11.45670435, -257.5554686, 131.5667557), x=(-0.9742020149, -0.2245304731, -0.02272665285), y=(0.02265156901, -0.1974803183, 0.9800451165)), Plane(origin=(-4.043541148, -259.012895, 123.1589417), x=(-0.9824954775, -0.1849965287, -0.02188426413), y=(0.007849735981, -0.1584857942, 0.9873300536)), Plane(origin=(-19.7061908, -260.621374, 58.99762091), x=(-0.9917745565, -0.12704108, 0.01561387489), y=(0.0009991609617, 0.1142984493, 0.9934459553))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])
geometry_5 = Geometry([Plane(origin=(20.00949203, -267.6585518, 167.051147), x=(-0.9765919175, -0.212767767, -0.03159278532), y=(0.06244257573, -0.4209748274, 0.9049205045)), Plane(origin=(18.54185183, -253.8058761, 119.1938906), x=(-0.9698341398, -0.2434366882, -0.01266175937), y=(0.01972924504, -0.1301597398, 0.991296726)), Plane(origin=(2.716405825, -255.3842468, 81.32405356), x=(-0.9814958783, -0.1914477887, 0.003685800351), y=(-0.002470917068, 0.03191004211, 0.9994876907)), Plane(origin=(11.45670435, -257.5554686, 131.5667557), x=(-0.9742020149, -0.2245304731, -0.02272665285), y=(0.02265156901, -0.1974803183, 0.9800451165)), Plane(origin=(-4.043541148, -259.012895, 123.1589417), x=(-0.9824954775, -0.1849965287, -0.02188426413), y=(0.007849735981, -0.1584857942, 0.9873300536)), Plane(origin=(-19.7061908, -260.621374, 58.99762091), x=(-0.9917745565, -0.12704108, 0.01561387489), y=(0.0009991609617, 0.1142984493, 0.9934459553))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])
geometry_6 = Geometry([Plane(origin=(20.00949203, -267.6585518, 167.051147), x=(-0.9765919175, -0.212767767, -0.03159278532), y=(0.06244257573, -0.4209748274, 0.9049205045)), Plane(origin=(18.54185183, -253.8058761, 119.1938906), x=(-0.9698341398, -0.2434366882, -0.01266175937), y=(0.01972924504, -0.1301597398, 0.991296726)), Plane(origin=(2.716405825, -255.3842468, 81.32405356), x=(-0.9814958783, -0.1914477887, 0.003685800351), y=(-0.002470917068, 0.03191004211, 0.9994876907)), Plane(origin=(11.45670435, -257.5554686, 131.5667557), x=(-0.9742020149, -0.2245304731, -0.02272665285), y=(0.02265156901, -0.1974803183, 0.9800451165)), Plane(origin=(-4.043541148, -259.012895, 123.1589417), x=(-0.9824954775, -0.1849965287, -0.02188426413), y=(0.007849735981, -0.1584857942, 0.9873300536)), Plane(origin=(-19.7061908, -260.621374, 58.99762091), x=(-0.9917745565, -0.12704108, 0.01561387489), y=(0.0009991609617, 0.1142984493, 0.9934459553))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])

# ----
read_file_2 = ReadFile(File="C:\Zac\GitHub\3d_printing_teamwork\skinPattern\combine.py", PerLineParse=False)
entwine = Entwine(Branch00=geometry_5, Branch01=geometry_4, Branch02=geometry_6, FlattenInputs=True)  # -> simplify(Result)
param_viewer = ParamViewer(entwine)
ghpython_script_2 = GhPythonScript(
    Code=read_file_2,
    Nested_list_pts=control_points.Points,
    Srf=surface_3,
    Flip_vect=Toggle(False),
    Layer_height=layer_height,
    Layer_nbr=layer_nbr,
    Plns_move_pt=point_2,
    Min_layer_height=min_layer_height,
    Max_layer_height=max_layer_height)  # -> Out, Pts_divisions, Pts_planes, Moved_planes, Layered_planes
panel_2 = Panel(entwine)
geometry_7 = Geometry(ghpython_script_2.Layered_planes)
geometry_8 = Geometry(ghpython_script_2.Pts_divisions)
geometry_9 = Geometry(ghpython_script_2.Pts_planes)
geometry_10 = Geometry(ghpython_script_2.Moved_planes)
geometry_11 = Geometry([Plane(origin=(-170.3748097, -245.1609135, 32.71951661), x=(-0.4760054797, 0.8778509704, 0.05288153896), y=(-0.1404595787, -0.1352462332, 0.9808055685)), Plane(origin=(-174.1954794, -240.6134388, 40.77131558), x=(-0.3939883133, 0.9143216289, 0.09375056199), y=(-0.1410769986, -0.1609508276, 0.9768275751)), Plane(origin=(-174.9027211, -239.6908582, 42.36326997), x=(-0.3827323521, 0.9183404607, 0.1008302781), y=(-0.1412999319, -0.1660436614, 0.9759425351)), Plane(origin=(-178.4252368, -234.8258817, 50.63127753), x=(-0.3434485948, 0.9295433256, 0.1341352617), y=(-0.1425606863, -0.1927669692, 0.9708333257)), Plane(origin=(-179.0315521, -233.9318188, 52.06084025), x=(-0.3389744934, 0.9303688311, 0.1396786701), y=(-0.1427254503, -0.197605152, 0.969835888)), Plane(origin=(-179.4918719, -233.6535961, 53.77002545), x=(-0.3377076106, 0.93033877, 0.1429102616), y=(-0.1431605953, -0.2008322038, 0.9691085955))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])
panel_3 = Panel(ghpython_script_2.Out)

list_item = ListItem(List=geometry_7, Index=Slider(1000, range=0..1000), Wrap=True)

panel_4 = Panel(geometry_10)
