# Grasshopper definition skinPattern.ghx (Grasshopper 1.0.7)
# plug-ins: ScriptParasite

never_change = BooleanToggle(True)
ziteration = Slider(300, range=0..500)
maxradius = Slider(7, range=0..10)
mimradius = Slider(1, range=0..10)
filletratio = Slider(0.38, range=0..1)
reset = Button()
curve = Curve(<curve referenced from the Rhino model>)
point = Point(<point referenced from the Rhino model>)
number_slider = Slider(100, range=0..100)
number_slider_2 = Slider(364, range=0..1000)
geometry = Geometry(<curve referenced from the Rhino model>)
geometry_2 = Geometry(<curve referenced from the Rhino model>)
panel = Panel("C:\Zac\GitHub\3d_printing_teamwork\skinPattern\circleTangent")
tangent_arcs = TangentArcs(CircleA=geometry, CircleB=geometry_2, Radius=Slider(18, range=0..100))  # -> ArcA, ArcB
c_script = CSharpScript(X=geometry, Y=geometry_2)  # -> Out, A
tangent_lines_ex = TangentLinesEx(CircleA=geometry, CircleB=geometry_2)  # -> Tangent1, Tangent2
tangent_lines_in = TangentLinesIn(CircleA=geometry, CircleB=geometry_2)  # -> Tangent1, Tangent2

panel_2 = Panel("skinPattern\skinPattern.py")  # disabled
ghpython_script = GhPythonScript(file_name=panel_2)  # -> path; disabled
# ---------- ghpython_script: Python ----------
a = ghdoc.Path

path = a.split('3d_printing_teamwork')[0]+r'3d_printing_teamwork\\'+file_name
# ---------- end ghpython_script ----------
read_file = ReadFile(File=ghpython_script, PerLineParse=False)  # disabled

curve_2 = Curve(<curve referenced from the Rhino model>)
divide_curve = DivideCurve(Curve=curve_2, Count=Slider(50, range=0..100), Kinks=never_change)  # -> Points, Tangents, Parameters

c_script_2 = CSharpScript(
    Points=divide_curve.Points,
    Iteration=ziteration,
    MaxRadius=maxradius,
    MinRadius=mimradius,
    AttractPoint=point,
    Edge=curve,
    MaxCount="300",
    FilletRatio=filletratio)  # -> out, OutPoints, Radiuses, OutTemp; inputs Points: list of Point3d, Iteration: Double, MaxRadius: Double, MinRadius: Double, AttractPoint: Point3d, Edge: Curve, MaxCount: Int32, FilletRatio: Double
# ---------- c_script_2: C# ----------
    // !Initialization
    List<Circle> circles = new List<Circle>();
    List<double> radiuses = new List<double>();


    for (int i = 0; i < Points.Count; i++)
    {
      radiuses.Add(Remap(Points[i].DistanceTo(AttractPoint), 20, 0, MinRadius, MaxRadius));
    }

    //!Iteration
    for (int iteration = 0; iteration < Iteration; iteration++)
    {

      List<Vector3d> totalVector = new List<Vector3d>();
      List<double> counts = new List<double>();
      for (int i = 0; i < Points.Count; i++)
      {
        totalVector.Add(new Vector3d(0, 0, 0));
        counts.Add(0);
      }

      for (int i = 0; i < Points.Count; i++)
        for (int j = i + 1; j < Points.Count; j++)
        {
          double distance = Points[i].DistanceTo(Points[j]);
          if (radiuses[i] + radiuses[j] > distance)
          {

            Vector3d subVector = Points[i] - Points[j];
            subVector.Unitize();
            subVector *= 1 * (radiuses[i] + radiuses[j] - distance);
            // subVector *= 0.5 / distance;
            // subVector *= 
            totalVector[i] += subVector;
            totalVector[j] -= subVector;
            counts[i] += 1;
            counts[j] += 1;

          }


        }


      for (int k = 0; k < Points.Count; k++)
        if (counts[k] != 0)
        {
          if (Edge.Contains(Points[k], Plane.WorldXY, 0.01) == PointContainment.Inside)
          {
            Vector3d move = totalVector[k] / counts[k];
            // Vector3d move = totalVector[k] ;
            Points[k] += move;
          }

        }

      //! Add points
      if (Points.Count < MaxCount)
      {
        List<int> Indices = new List<int>();

        for (int i = 0; i < Points.Count - 1; i++)
        {
          if (Points[i].DistanceTo(Points[i + 1]) > radiuses[i] + radiuses[i + 1])
          { Indices.Add(i + 1 + Indices.Count); }
        }
        foreach (int Index in Indices)
        {
          if (Points.Count < MaxCount)
          {
            Point3d addPoint = 0.5 * (Points[Index - 1] + Points[Index]);
            Points.Insert(Index, addPoint);
          }
        }
      }


      // ! Generate the radius
      radiuses = new List<double>();
      for (int i = 0; i < Points.Count; i++)
      {
        radiuses.Add(Remap(Points[i].DistanceTo(AttractPoint), 20, 0, MinRadius, MaxRadius));
      }

      // Print(totalVector[54].Length.ToString());
    }


    //! Make curve




    //!Info
    Print("Points.Count =" + Points.Count.ToString());
    // ! Output
    // zOutTemp = curves;
    OutPoints = Points;
    Radiuses = radiuses;
# ---------- c_script_2: C# additional code ----------
  bool IsLinear(Point3d p0, Point3d p1, Point3d p2)
  {

    Vector3d v1 = new Vector3d(p1 - p0);
    Vector3d v2 = new Vector3d(p2 - p1);
    

    double x = v1.X / v2.X;

    if (v1.Y / v2.Y == x && v1.Z / v2.Z == x) { return true; }
    else return false;
  }
  double Remap(double x, double t1, double t2, double s1, double s2)
  {
    double mapped = (s2 - s1) / (t2 - t1) * (x - t1) + s1;
    if (mapped < s1) mapped = s1;
    if (mapped > s2) mapped = s2;
    return mapped;
    // return (x - t1) / (t2 - t1) * (s2 - s1) + s1;
  }
# ---------- end c_script_2 ----------
script_parasite = ScriptParasite(Enable=Toggle(False), Folder="C:\Zac\GitHub\3d_printing_teamwork\skinPattern\csharp")

ghpython_script_2 = GhPythonScript(Code=read_file, Points=divide_curve.Points, Reset=reset, Radius=maxradius, Edge=curve, MaxCounts="300")  # -> Out, OutPoints; disabled
panel_3 = Panel(ghpython_script_2.Out)  # disabled

panel_4 = Panel(c_script_2.out)

polyline = PolyLine(Vertices=c_script_2.OutPoints, Closed=False)
subtraction = Subtraction(A=c_script_2.Radiuses, B=Slider(0.1, range=0..0.5))
list_item = ListItem(List=c_script_2.OutPoints, Index=number_slider_2, Wrap=True)  # -> Item, Item1, Item2, Item3
list_item_2 = ListItem(List=subtraction, Index=number_slider_2, Wrap=True)  # -> Item, Item1, Item2, Item3

relay = Relay([list_item_2.Item, list_item_2.Item1, list_item_2.Item2, list_item_2.Item3])
relay_2 = Relay([list_item.Item, list_item.Item1, list_item.Item2, list_item.Item3])

script_parasite_2 = ScriptParasite(Enable=Toggle(True), Folder=panel)
c_script_3 = CSharpScript(Points=c_script_2.OutPoints, Radius=subtraction)  # -> out, Dir, OutTemp; inputs Points: list of Point3d, Radius: list of Double
# ---------- c_script_3: C# usings ----------
using Rhino.Geometry.Intersect;
# ---------- c_script_3: C# ----------
    //! Params and declarations
    double maxTangentArcRadius = 2;
    double minTangentArcRadius = 0.3;

    Random random = new Random();
    List<NurbsCurve> curves = new List<NurbsCurve>();
    List<NurbsCurve> tangents = new List<NurbsCurve>();
    NurbsCurve curve = new NurbsCurve(0, 0);
    List<bool> dir = new List<bool>();



    //! Dir
    bool initial = false;//! true: clockwise, false: anti-clockwise
    dir.Add(initial);
    for (int i = 0; i < Points.Count - 1; i++)
    {
      initial = !initial;
      if (Points[i].DistanceTo(Points[i + 1]) < Radius[i] + Radius[i + 1]) { initial = !initial; }
      dir.Add(initial);

    }

    //! Curve
    for (int i = 0; i < Points.Count - 1; i++)
    {

      NurbsCurve l0 = new NurbsCurve(0, 0);
      NurbsCurve l1 = new NurbsCurve(0, 0);

      if (dir[i] != dir[i + 1]) //* Tangent line
      {
        getTangentLineCurves(Points[i], Radius[i], Points[i + 1], Radius[i + 1], out l0, out l1);
        if (dir[i]) tangents.Add(l0);
        else tangents.Add(l1);
      }

      else//* Tangent Arc
      {
        double radius = maxTangentArcRadius * (random.NextDouble() + minTangentArcRadius);
        // Print(radius.ToString());
        // radius = 0.3;
        getTangentArcs(Points[i], Radius[i], Points[i + 1], Radius[i + 1], radius, out l0, out l1);
      }
      if (dir[i]) tangents.Add(l0);
      else tangents.Add(l1);
    }



    //! Circle part

    for (int i = 0; i < tangents.Count - 1; i++)
    {
      curves.Add(tangents[i]);
      curves.Add(new Arc(tangents[i].PointAtEnd, tangents[i].TangentAtEnd, tangents[i + 1].PointAtStart).ToNurbsCurve());
    }
    curves.Add(tangents[tangents.Count - 1]);


    //! Output
    Dir = dir;
    // OutTemp = tangents;
    OutTemp = curves;
    //! End
# ---------- c_script_3: C# additional code ----------
  //! Start Tangent Arcs

  void getTangentArcs(Point3d p0, double r0, Point3d p1, double r1, double Radius, out NurbsCurve l0, out NurbsCurve l1)
  {

    double radius = (p0.DistanceTo(p1) - r0 - r1) / 2;
    if (radius < Radius)
    {

      Point3d intersectionPoint0 = new Point3d();
      Point3d intersectionPoint1 = new Point3d();

      CircleCircleIntersection(p0, r0 + Radius, p1, r1 + Radius, out intersectionPoint0, out intersectionPoint1);

      //! intersectionPoint0

      double t0 = r0 / p0.DistanceTo(intersectionPoint0);
      Point3d LCIntersection0 = p0 * (1 - t0) + intersectionPoint0 * t0;

      double t1 = r1 / p1.DistanceTo(intersectionPoint0);
      Point3d LCIntersection1 = p1 * (1 - t1) + intersectionPoint0 * t1;

      Vector3d centerToIntersectionPoint = new Vector3d(p0 - intersectionPoint0);

      Vector3d normal = new Vector3d(1, -centerToIntersectionPoint.X / centerToIntersectionPoint.Y, p0.Z);
      if (normal * new Vector3d(LCIntersection1 - LCIntersection0) < 0) { normal = -normal; }
      l0 = new Arc(LCIntersection0, normal, LCIntersection1).ToNurbsCurve();

      // l0 = new Line(intersectionPoint0, intersectionPoint1).ToNurbsCurve();


      //! IntersectionPoint1
      t0 = r0 / p0.DistanceTo(intersectionPoint1);
      LCIntersection0 = p0 * (1 - t0) + intersectionPoint1 * t0;

      t1 = r1 / p1.DistanceTo(intersectionPoint1);
      LCIntersection1 = p1 * (1 - t1) + intersectionPoint1 * t1;

      centerToIntersectionPoint = new Vector3d(p0 - intersectionPoint1);

      normal = new Vector3d(1, -centerToIntersectionPoint.X / centerToIntersectionPoint.Y, p0.Z);
      if (normal * new Vector3d(LCIntersection1 - LCIntersection0) < 0) { normal = -normal; }
      l1 = new Arc(LCIntersection0, normal, LCIntersection1).ToNurbsCurve();
      // l1 = null;


    }
    else
    {
      radius = Radius;
      Vector3d v = new Vector3d(p1 - p0);
      v.Unitize();

      Point3d pt0 = p0 + v * r0;
      Point3d pt1 = p1 - v * r1;
      Vector3d normal = new Vector3d(1, -v.X / v.Y, v.Z);

      l0 = new Arc(pt0, normal, pt1).ToNurbsCurve();
      l1 = new Arc(pt0, -normal, pt1).ToNurbsCurve();

    }


  }

  void CircleCircleIntersection(Point3d p0, double r0, Point3d p1, double r1, out Point3d intersection0, out Point3d intersection1)
  {

    double d = p0.DistanceTo(p1);//AB
    // if (d == r0 + r1)
    // {
    //   Print("wow".ToString());
    //   Print(r0.ToString());
    //   Print(r1.ToString());
    //   Print(d.ToString());
    // }

    // Print((d == r0 + r1).ToString());

    double cosA = (r1 * r1 + d * d - r0 * r0) / (2 * r1 * d);
    double d1 = r1 * cosA;
    double t1 = d1 / d;
    Point3d midPt = p0 * t1 + p1 * (1 - t1);


    double h = Math.Sqrt(Math.Pow(r1, 2) - Math.Pow(d1, 2)); //CE
    // Print(h.ToString());
    Vector3d normal = new Vector3d(p0 - p1);
    normal.Transform(Transform.Rotation(Math.PI * 0.5, Vector3d.ZAxis, p0));
    normal.Unitize();
    normal *= h;

    intersection0 = midPt - normal; //!Clockwise one
    intersection1 = midPt + normal;//!Anti-clockwise one

    // intersection0 = midPt ;
    // intersection1 = midPt +Vector3d.YAxis;


  }


  //! Start Tangent Lines
  void getTangentLineCurves(Point3d p0, double r0, Point3d p1, double r1, out NurbsCurve l0, out NurbsCurve l1)
  {
    Point3d r1_low_point = new Point3d();
    Point3d r0_up_point = new Point3d();
    Point3d r0_low_point = new Point3d();
    Point3d r1_up_point = new Point3d();

    double aa = Math.Atan2((p1.Y - p0.Y), (p1.X - p0.X));  //求中两个圆心连线的斜率角度
    double centerLine;

    centerLine = p0.DistanceTo(p1); //求两个圆心连线长度

    double bb = Math.Acos((r0 + r1) / centerLine);  //求两个圆心连线和圆心到切点垂线的夹角
    double cc = bb - aa;
    double r2LowX = r1 * Math.Cos(cc);
    double r2LowY = r1 * Math.Sin(cc);
    double r1UpX = r0 * Math.Cos(cc);
    double r1UpY = r0 * Math.Sin(cc);
    r1_low_point.X = p1.X - r2LowX;
    r1_low_point.Y = p1.Y + r2LowY;
    r0_up_point.X = p0.X + r1UpX;
    r0_up_point.Y = p0.Y - r1UpY;
    Point3d r2_tempoint = Transition(r1_low_point.X - p1.X, r1_low_point.Y - p1.Y, 2 * bb, 1);
    r1_up_point.X = p1.X + r2_tempoint.X;
    r1_up_point.Y = p1.Y + r2_tempoint.Y;
    Point3d r1_tempoint = Transition(r0_up_point.X - p0.X, r0_up_point.Y - p0.Y, 2 * bb, 1);
    r0_low_point.X = p0.X + r1_tempoint.X;
    r0_low_point.Y = p0.Y + r1_tempoint.Y;


    l0 = new Line(r0_low_point, r1_up_point).ToNurbsCurve(); //!Clockwise one
    l1 = new Line(r0_up_point, r1_low_point).ToNurbsCurve();//!Anti-clockwise one


  }
  //点绕点旋转
  Point3d Transition(double _x, double _y, double _angle, int fx)
  {
    double newX = 0;
    double newY = 0;
    if (fx == 1)
    {
      newX = _x * Math.Cos(_angle) - _y * Math.Sin(_angle);
      newY = _x * Math.Sin(_angle) + _y * Math.Cos(_angle);
    }
    else
    {
      newX = _x * Math.Cos(_angle) + _y * Math.Sin(_angle);
      newY = _y * Math.Cos(_angle) - _x * Math.Sin(_angle);
    }
    return new Point3d(newX, newY, 0);
  }
# ---------- end c_script_3 ----------

circle = Circle(Plane=c_script_2.OutPoints, Radius=subtraction)
list_item_3 = ListItem(List=c_script_3.OutTemp, Index=Slider(0, range=0..10), Wrap=True)
panel_5 = Panel(c_script_3.OutTemp)
panel_6 = Panel(c_script_3.out)
panel_7 = Panel(c_script_3.Dir)
