# Grasshopper definition visualization.ghx (Grasshopper 1.0.7)

# INPUT
# WORKING FILES
panel = Panel("\dependencies\master_navigation_data.json")
ghpython_script = GhPythonScript(file_name=panel)  # -> ROBOT_IP, TCP, ROBOT_BASE
# ---------- ghpython_script: Python ----------
import Rhino.Geometry as rg

def set_robot_base():
    pt_0 = rg.Point3d(data['origin'][0],data['origin'][1],data['origin'][2]) # base plane origin
    pt_1 = rg.Point3d(data['origin_x'][0],data['origin_x'][1],data['origin_x'][2]) # point on positive x axis
    pt_2 = rg.Point3d(data['origin_y'][0],data['origin_y'][1],data['origin_y'][2]) # point on positive xy plane
    robot_base = rg.Plane(pt_0,pt_1-pt_0,pt_2-pt_0)
    return robot_base


a = ghdoc.Path

path = a.split('3d_printing_teamwork')[0]+r'3d_printing_teamwork\\'+file_name
import json
with open(path) as f:
   data = json.load(f)

ROBOT_IP = data['ip']
TCP = data['tcp']
ROBOT_BASE = set_robot_base()
# ---------- end ghpython_script ----------
ghpython_script_2 = GhPythonScript(file_name="/working_file_zac/excution.py")  # -> path
# ---------- ghpython_script_2: Python ----------
a = ghdoc.Path

path = a.split('3d_printing_teamwork')[0]+r'3d_printing_teamwork\\'+file_name
# ---------- end ghpython_script_2 ----------
read_file = ReadFile(File=ghpython_script_2, PerLineParse=False)
number_slider = Slider(10, range=0..10)
safe_robot_acc = Slider(0.5, range=0..1)
safe_robot_vel = Slider(0.5, range=0..1)
safe_sleep_time = Slider(0.1, range=0..1)
safe_dist = Slider(100, range=50..200)
construct_plane = ConstructPlane(Origin=Point(0, 0, 0), XAxis=Vector(1, 0, 0), YAxis=Vector(0, 1, 0))
deconstruct = Deconstruct()  # -> XComponent, YComponent, ZComponent
number_slider_2 = Slider(100, range=0..100)
number_slider_3 = Slider(10, range=0..10)
move = Move(Motion=Vector(0, 0, 10))  # -> Geometry, Transform
subtraction = Subtraction(B=100)
construct_point = ConstructPoint(XCoordinate="-100", YCoordinate=0, ZCoordinate=0)
python = GhPythonScript(
    Code=read_file,
    NAVIGATION_JSON=panel,
    SAFE_ROBOT_ACC=safe_robot_acc,
    SAFE_ROBOT_VEL=safe_robot_vel,
    SAFE_SLEEP_TIME=safe_sleep_time,
    SAFE_DIST=safe_dist,
    Fabricate=Button(),
    Is_debug_mode=Toggle(True),
    Debug_plane=construct_point)  # -> Out, Script
panel_2 = Panel(python.Out)
panel_3 = Panel(python.Script)
